# Grasshopper definition ParametricFurniture.gh (Grasshopper 1.0.8)

number_slider = Slider(16.698, range=0..30)
number_slider_2 = Slider(26.315, range=0..30)
pt = ConstructPoint(XCoordinate=0, YCoordinate=0, ZCoordinate=0)
pt_2 = ConstructPoint(XCoordinate=number_slider_2, YCoordinate=number_slider, ZCoordinate=0)
pt_3 = ConstructPoint(XCoordinate=0, YCoordinate=0, ZCoordinate=Slider(4.283, range=0..10))
pt_4 = ConstructPoint(XCoordinate=number_slider_2, YCoordinate=number_slider, ZCoordinate=Slider(0, range=0..10))
pt_5 = ConstructPoint(XCoordinate=Slider(28.778, range=0..50), YCoordinate=Slider(40.606, range=0..50), ZCoordinate=0)
number_slider_3 = Slider(10.237, range=0..20)
number_slider_4 = Slider(3.829, range=0..20)
xz = XZPlane(Origin=pt_2)
xy = XYPlane(Origin=pt_3)
xy_2 = XYPlane(Origin=pt_4)
planesrf = PlaneSurface(Plane=PlaneXY(0, 0, 0), XSize=Domain(-20, 20), YSize=Domain(-20, 20))
sph = Sphere(Base=PlaneXY(0, 0, 0), Radius=Slider(7.215, range=0..30))
pt_6 = ConstructPoint(XCoordinate=0, YCoordinate=0, ZCoordinate=0)
rot3d = Rotate3D(Geometry=pt_2, Angle=Slider(-2.042, range=-3.14..3.14), Center=Point(0, 0, 0), Axis=Vector(0, 0, 1))  # -> Geometry, Transform
rot3d_2 = Rotate3D(Geometry=pt_2, Angle=Slider(1.951, range=-3.14..3.14), Center=Point(0, 0, 0), Axis=Vector(0, 0, 1))  # -> Geometry, Transform
cone = Cone(Base=PlaneXY(0, 0, 0), Radius=Slider(2.439, range=2..10), Length=Slider(7.644, range=5..15))  # -> Cone, Tip
sph_2 = Sphere(Base=xy, Radius=Slider(17.652, range=0..30))
# The head's size can be altered, and its scale.
head = ScaleNU(Geometry=sph, Plane=PlaneXY(0, 0, 0), ScaleX=1, ScaleY=1, ScaleZ=Slider(0.904, range=0..1))  # -> Geometry, Transform
line = LineSDL(Start=pt_6, Direction=Vector(0, 0, 1), Length=1)
ellipse = Ellipse(Plane=xy_2, Radius1=Slider(6.637, range=0..30), Radius2=Slider(6.782, range=0..30))  # -> Ellipse, Focus1, Focus2
ellipse_2 = Ellipse(Plane=xz, Radius1=Slider(12.048, range=0..30), Radius2=Slider(6.396, range=0..30))  # -> Ellipse, Focus1, Focus2
pt_7 = ConstructPoint(XCoordinate=Slider(5.817, range=0..50), YCoordinate=Slider(41.301, range=0..50), ZCoordinate=0)
vec2pt = Vector2Pt(PointA=pt, PointB=pt_5, Unitize=False)  # -> Vector, Length
mdif = MeshDifference(MeshesA=sph_2, MeshesB=planesrf)
vec2pt_2 = Vector2Pt(PointA=pt, PointB=pt_7, Unitize=False)  # -> Vector, Length
pdecon = Deconstruct(Point=xy_2)  # -> XComponent, YComponent, ZComponent
move = Move(Geometry=head.Geometry, Motion=vec2pt.Vector)  # -> Geometry, Transform
revsrf = Revolution(Curve=ellipse_2.Ellipse, Axis=line, Domain=Domain(0, 6.283185307))
pt_8 = ConstructPoint(
    XCoordinate=Slider(22.803, range=10..30),
    YCoordinate=Slider(13.639, range=10..30),
    ZCoordinate=Slider(18.907, range=10..30.001))
pt_9 = ConstructPoint(
    XCoordinate=Slider(15.868, range=10..30),
    YCoordinate=Slider(10.766, range=10..30),
    ZCoordinate=Slider(30.001, range=10..30.001))
pdecon_2 = Deconstruct(Point=rot3d_2.Geometry)  # -> XComponent, YComponent, ZComponent
pdecon_3 = Deconstruct(Point=rot3d.Geometry)  # -> XComponent, YComponent, ZComponent
pt_10 = ConstructPoint(XCoordinate=pdecon.XComponent, YCoordinate=pdecon.YComponent, ZCoordinate=Slider(44.387, range=30..50))
# The beak's length can be altered, as well as its base radius.
move_2 = Move(Geometry=cone.Cone, Motion=vec2pt_2.Vector)  # -> Geometry, Transform
# This creates the body; the flatness/roundness can be scaled and the offset from the z-axis can be altered, also creating a more rounded/flattened form.
body = ScaleNU(Geometry=mdif, Plane=PlaneXY(0, 0, 0), ScaleX=1, ScaleY=1, ScaleZ=Slider(0.779, range=0..1))  # -> Geometry, Transform
py3 = Python3Script(n=Slider(18, range=1..30), length=Slider(23, range=1..30))  # -> out, x, y; inputs n: Int32, length: Int32
# ---------- py3: Python ----------
"""Grasshopper Script"""
import rhinoscriptsyntax as rs
import math
import numpy as np

def curve1(n,length):
    xpoints = np.linspace(0,length,n)
    flat_curve = []
    points = []
    for i in xpoints:
        p = rs.AddPoint((-i,0,3*math.log(i+1)))
        points.append(p)
        q = rs.AddPoint((-i,0,0))
        flat_curve.append(q)
    
    return flat_curve, points

x,y = curve1(n,length)
# ---------- end py3 ----------
pt_11 = ConstructPoint(XCoordinate=pdecon_3.XComponent, YCoordinate=pdecon_3.YComponent, ZCoordinate=Slider(5.147, range=0..20))
pt_12 = ConstructPoint(XCoordinate=pdecon_2.XComponent, YCoordinate=pdecon_2.YComponent, ZCoordinate=0)
vec = VectorXYZ(XComponent=1, YComponent=1, ZComponent=-2)  # -> Vector, Length
merge = Merge(Data1=xy_2, Data2=pt_8, Data3=pt_9, Data4=pt_10)
xz_2 = XZPlane(Origin=pt_11)
pt_13 = ConstructPoint(XCoordinate=0, YCoordinate=0, ZCoordinate=0)
yz = YZPlane(Origin=pt_12)
intcrv = Interpolate(Vertices=py3.x, Degree=3, Periodic=False, KnotStyle=1)  # -> Curve, Length, Domain
line_2 = LineSDL(Start=rot3d.Geometry, Direction=vec.Vector, Length=1)
intcrv_2 = Interpolate(Vertices=py3.y, Degree=3, Periodic=False, KnotStyle=1)  # -> Curve, Length, Domain
stretch = Stretch(Geometry=revsrf, Axis=Line((0, 0, 0), (10, 10, 0)), Length=Slider(12.439, range=0..30), Rigid=False)
vec2pt_3 = Vector2Pt(PointA=pt_13, PointB=pt_11, Unitize=False)  # -> Vector, Length
ellipse_3 = Ellipse(Plane=yz, Radius1=1, Radius2=1)  # -> Ellipse, Focus1, Focus2
line_3 = LineSDL(Start=pt_12, Direction=Vector(0, 0, 1), Length=1)
intcrv_3 = Interpolate(Vertices=merge, Degree=Slider(7, range=1..10), Periodic=False, KnotStyle=1)  # -> Curve, Length, Domain
rulesrf = RuledSurface(CurveA=intcrv.Curve, CurveB=intcrv_2.Curve)
line_4 = LineSDL(Start=pt_11, Direction=Vector(0, 0, 1), Length=1)
extrcrv = ExtrudeAlong(Base=ellipse.Ellipse, Curve=intcrv_3.Curve)
X = UnitX(Factor=1)
move_3 = Move(Geometry=rulesrf, Motion=vec2pt_3.Vector)  # -> Geometry, Transform
line_5 = LineSDL(Start=pt_11, Direction=expr("-x", X), Length=1)
pl = ConstructPlane(Origin=Point(0, 0, 0), XAxis=Vector(1, 0, 0), YAxis=Vector(0, 1, 0))
revsrf_2 = Revolution(Curve=move_3.Geometry, Axis=line_5, Domain=Slider(0.747, range=0..3.14))
sph_3 = Sphere(Base=pl, Radius=Slider(7.476, range=0..20))
stretch_2 = Stretch(Geometry=sph_3, Axis=Line((0, 0, 0), (10, 10, 0)), Length=Slider(30, range=0..30), Rigid=False)
vec2pt_4 = Vector2Pt(PointA=pl, PointB=pt_10, Unitize=False)  # -> Vector, Length
move_4 = Move(Geometry=stretch_2, Motion=vec2pt_4.Vector)  # -> Geometry, Transform
merge_2 = Merge(Data1=stretch, Data2=extrcrv, Data3=move_4.Geometry)
sunion = SolidUnion(Breps=merge_2)
