# Grasshopper definition ParametrizedCustomPlane.gh (Grasshopper 1.0.8)

number_slider = Slider(5.997, range=0..20)
number_slider_2 = Slider(5.228, range=0..20)
pt = ConstructPoint(XCoordinate=number_slider_2, YCoordinate=number_slider, ZCoordinate=Slider(1.346, range=0..15))
pt_2 = ConstructPoint(XCoordinate=number_slider_2, YCoordinate=number_slider, ZCoordinate=Slider(17.364, range=0..30))
xy = XYPlane(Origin=pt)
pt_3 = ConstructPoint(XCoordinate=number_slider_2, YCoordinate=number_slider, ZCoordinate=0)
pdecon = Deconstruct(Point=pt_3)  # -> XComponent, YComponent, ZComponent
xy_2 = XYPlane(Origin=pt_3)
pt_4 = ConstructPoint(XCoordinate=Slider(2.558, range=0..20), YCoordinate=Slider(0, range=0..20), ZCoordinate=Slider(23.115, range=0..35))
polygon = Polygon(Plane=xy, Radius=Slider(5.128, range=0..30), Segments=Slider(5, range=0..12), FilletRadius=0)  # -> Polygon, Length
pt_5 = ConstructPoint(XCoordinate=pdecon.XComponent, YCoordinate=pdecon.YComponent, ZCoordinate=0.3)
xy_3 = XYPlane(Origin=pt_2)
polygon_2 = Polygon(Plane=xy_2, Radius=Slider(2.95, range=0..30), Segments=Slider(5, range=0..12), FilletRadius=0)  # -> Polygon, Length
polygon_3 = Polygon(Plane=xy_3, Radius=Slider(14.872, range=0..30), Segments=Slider(5, range=0..12), FilletRadius=0)  # -> Polygon, Length
merge = Merge(Data1=polygon_2.Polygon, Data2=polygon.Polygon, Data3=polygon_3.Polygon)
merge_2 = Merge(Data1=pt_5, Data2=pt_2, Data3=pt_4)
loft = Loft(Curves=merge, Options={Adjust=False, Closed=False, LoftEnds=0, LoftSimp=0, LoftType=0, Rebuild=10, Refit=0.01})
cir = Circle(Plane=pt_5, Radius=Slider(0.497, range=0..2))
sph = Sphere(Base=pt_4, Radius=Slider(3.106, range=0..10))
intcrv = Interpolate(Vertices=merge_2, Degree=Slider(5, range=1..10), Periodic=False, KnotStyle=1)  # -> Curve, Length, Domain
cap = CapHoles(Brep=loft)
extrcrv = ExtrudeAlong(Base=cir, Curve=intcrv.Curve)
merge_3 = Merge(Data1=cap, Data2=extrcrv, Data3=sph)
sunion = SolidUnion(Breps=merge_3)
number_slider_3 = Slider(0, range=0..180)
vec = VectorXYZ(XComponent=Slider(12.179, range=0..30), YComponent=Slider(9.747, range=0..30), ZComponent=Slider(2.735, range=0..30))  # -> Vector, Length
rot3d = Rotate3D(Geometry=sunion, Angle=expr("Rad(x)", number_slider_3), Center=Point(0, 0, 0), Axis=vec.Vector)  # -> Geometry, Transform
bbox = BoundingBox(Content=rot3d.Geometry, Plane=PlaneXY(0, 0, 0))  # -> Box, Box_2
debox = DeconstructBox(Box=bbox.Box)  # -> Plane, X, Y, Z
dedomain = DeconstructDomain(Domain=debox.Y)  # -> Start, End
dedomain_2 = DeconstructDomain(Domain=debox.X)  # -> Start, End
dedomain_3 = DeconstructDomain(Domain=debox.Z)  # -> Start, End
list = ValueList({"X", "Y", "Z", "custom"}, selected="custom")
# This controls the spacing of the sliced curves on the XY plane
number_slider_4 = Slider(26, range=0..30)
# (x_0, y_0): plane origin
# x, y: box dims
# spacing: material thickness
py3 = Python3Script(
    axis=list,
    custom_vec=vec.Vector,
    x=dedomain_2.End,
    y=dedomain.End,
    spacing=Slider(2.096, range=0..3),
    x_0=dedomain_2.Start,
    y_0=dedomain.Start,
    z_0=dedomain_3.Start,
    z_end=dedomain_3.End)  # -> out, a, nl; inputs x: Double, y: Double
# ---------- py3: Python ----------
"""Grasshopper Script"""

import rhinoscriptsyntax as rs
import math


def make_layers(spacing,x,y,x_0,y_0,z_0,z_end,axis,custom_vec=None):
    rects = []
    num_layers = int((z_end-z_0)//spacing) + 1
    
    z_offset = 0
    x_offset = 0.5*x
    y_offset = 0.5*y
    print(custom_vec)
    deg = 0

    for i in range(num_layers + 1):
        p = rs.WorldXYPlane()
        if axis == "X":
            p = rs.RotatePlane(p,deg,p.XAxis)
            offset = x*math.tan(math.radians(deg))
        if axis == "Y":
            p = rs.RotatePlane(p,deg,p.YAxis)
            offset = -1*x*math.tan(math.radians(deg))
        if axis == "Z":
            p = rs.RotatePlane(p,deg,p.ZAxis)
        if axis == "custom":
            p = rs.RotatePlane(p,deg,custom_vec)

        p = rs.MovePlane(p,(x_0-x_offset,y_0-y_offset,z_0+i*spacing-z_offset))
        rect = rs.AddRectangle(p,2*x,2*y)
        rects.append(rect)
    return rects, num_layers+10

a,nl = make_layers(spacing,x,y,x_0,y_0,z_0,z_end,axis,custom_vec)
# ---------- end py3 ----------
series = Series(Start=0, Step=number_slider_4, Count=py3.nl)
brep = Brep(py3.a)
bbx = BrepBrep(BrepA=brep, BrepB=rot3d.Geometry)  # -> Curves, Points
pt_6 = ConstructPoint(XCoordinate=series, YCoordinate=0, ZCoordinate=0)  # -> graft(Point)
debrep = DeconstructBrep(Brep=bbx.Curves)  # -> Faces, Edges, Vertices
series_2 = Series(Start=0, Step=1, Count=py3.nl)  # -> graft(Series)
area = Area(Geometry=debrep.Faces)  # -> Area, Centroid
vec2pt = Vector2Pt(PointA=area.Centroid, PointB=pt_6, Unitize=False)  # -> graft(Vector), Length
move = Move(Geometry=bbx.Curves, Motion=vec2pt.Vector)  # -> Geometry, Transform
debrep_2 = DeconstructBrep(Brep=move.Geometry)  # -> Faces, Edges, Vertices
end = EndPoints(Curve=debrep_2.Faces)  # -> Start, End
area_2 = Area(Geometry=debrep_2.Faces)  # -> Area, Centroid
ln = Line(StartPoint=end.End, EndPoint=area_2.Centroid)
textsrf = TextOnSurface(Text=series_2, Font="Sans Bold:no Italic:no", Height=1, Depth=0, BaseLine=ln, BaseSurface=debrep_2.Faces)
merge_4 = Merge(Data1=move.Geometry, Data2=textsrf)
rot3d_2 = Rotate3D(Geometry=merge_4, Angle=expr("Rad(x)", number_slider_3), Center=Point(0, 0, 0), Axis=expr("-1*x", vec.Vector))  # -> Geometry, Transform; disabled
movetoplane = MoveToPlane(Geometry=rot3d_2.Geometry, Plane=PlaneXY(0, 0, 0), Above=True, Below=True)  # -> Geometry, Transform; disabled
